# Grasshopper definition exampleDesignConfig.gh (Grasshopper 1.0.7)
# plug-ins: Speckle 2, Rangekeeper

pipeline = GeometryPipeline(
    GroupByLayer=False,
    GroupByType=False,
    IncludeHidden=True,
    IncludeLocked=True,
    LayerFilter="streets::road::laneEndGuides",
    NameFilter="*",
    SublayerFiltering=True,
    TypeFilter=4)
pipeline_2 = GeometryPipeline(
    GroupByLayer=False,
    GroupByType=False,
    IncludeHidden=True,
    IncludeLocked=True,
    LayerFilter="streets::road::clGuides",
    NameFilter="*",
    SublayerFiltering=True,
    TypeFilter=4)
number_slider = Slider(0.1, range=0..0.1)
number_slider_2 = Slider(0.05, range=0..0.1)
panel = Panel("""3
3""")
neg = Negative(Value=number_slider)
geo = Geometry(pipeline_2)
dash = DashPattern(Curve=geo, Pattern=panel)  # -> Dashes, Gaps
offset = OffsetCurve(Curve=graft(pipeline), Distance=[number_slider, neg], Corners=1)
neg_2 = Negative(Value=number_slider_2)
number_slider_3 = Slider(0.1, range=0..0.1)
pshift = ShiftPaths(Data=offset, Offset=-1)

# ---- group: residential
colour = ColourPicker(PickedColour=RGB(191, 139, 86))
sso = RenderMaterial(
    Opacity=1,
    Metalness=0,
    Roughness=1,
    Diffuse=colour,
    SelectedConstructorName="Objects.Other.RenderMaterial.ctor(System.Double,System.Double,System.Double,System.Nullable`1[System.Drawing.Color],System.Nullable`1[System.Drawing.Color])",
    SelectedTypeName="Objects.Other.RenderMaterial",
    UseSchemaTag=False,
    UserSetSchemaTag=False,
    seed="bbf2131ca3a81de82325")

# ---- group: parking
colour_2 = ColourPicker(PickedColour=RGB(61, 130, 153))
sso_2 = RenderMaterial(
    Opacity=1,
    Metalness=0,
    Roughness=1,
    Diffuse=colour_2,
    SelectedConstructorName="Objects.Other.RenderMaterial.ctor(System.Double,System.Double,System.Double,System.Nullable`1[System.Drawing.Color],System.Nullable`1[System.Drawing.Color])",
    SelectedTypeName="Objects.Other.RenderMaterial",
    UseSchemaTag=False,
    UserSetSchemaTag=False,
    seed="99332c52d9b1d43c6ab1")

# ---- group: retail
colour_3 = ColourPicker(PickedColour=RGB(153, 54, 103))
sso_3 = RenderMaterial(
    Opacity=1,
    Metalness=0,
    Roughness=1,
    Diffuse=colour_3,
    SelectedConstructorName="Objects.Other.RenderMaterial.ctor(System.Double,System.Double,System.Double,System.Nullable`1[System.Drawing.Color],System.Nullable`1[System.Drawing.Color])",
    SelectedTypeName="Objects.Other.RenderMaterial",
    UseSchemaTag=False,
    UserSetSchemaTag=False,
    seed="0549a8a3ccfd902fce3c")

# ----
offset_2 = OffsetCurve(Curve=graft(dash.Dashes), Distance=[number_slider_2, neg_2], Corners=1)
loft = Loft(Curves=pshift, Options={Adjust=False, Closed=False, LoftEnds=0, LoftSimp=0, LoftType=0, Rebuild=10, Refit=0.01})
Z = UnitZ(Factor=Slider(0.02, range=0..0.1))
pshift_2 = ShiftPaths(Data=offset_2, Offset=-1)
number_slider_4 = Slider(0.1, range=0..0.1)
extr = Extrude(Base=loft, Direction=Z)
loft_2 = Loft(Curves=pshift_2, Options={Adjust=False, Closed=False, LoftEnds=0, LoftSimp=0, LoftType=0, Rebuild=10, Refit=0.01})
cap = CapHoles(Brep=extr)
Z_2 = UnitZ(Factor=Slider(0.02, range=0..0.1))
extr_2 = Extrude(Base=loft_2, Direction=Z_2)
cap_2 = CapHoles(Brep=extr_2)
panel_2 = Panel(cap_2)

geo_2 = Geometry(<brep referenced from the Rhino model>)
c_script = CSharpScript()  # -> A
# ---------- c_script: C# ----------
A = Guid.NewGuid().ToString();
# ---------- end c_script ----------

geo_3 = Geometry(<brep referenced from the Rhino model>)
c_script_2 = CSharpScript()  # -> A; same code as c_script

geo_4 = Geometry(<brep referenced from the Rhino model>)
c_script_3 = CSharpScript()  # -> A; same code as c_script

geo_5 = Geometry(<brep referenced from the Rhino model>)
c_script_4 = CSharpScript()  # -> A; same code as c_script

geo_6 = Geometry(<brep referenced from the Rhino model>)
c_script_5 = CSharpScript()  # -> A; same code as c_script

geo_7 = Geometry(<brep referenced from the Rhino model>)
c_script_6 = CSharpScript()  # -> A; same code as c_script

geo_8 = Geometry(<brep referenced from the Rhino model>)
c_script_7 = CSharpScript()  # -> A; same code as c_script

colour_4 = ColourPicker(PickedColour=RGB(191, 139, 86))
sso_4 = RenderMaterial(
    Opacity=1,
    Metalness=0,
    Roughness=1,
    Diffuse=colour_4,
    SelectedConstructorName="Objects.Other.RenderMaterial.ctor(System.Double,System.Double,System.Double,System.Nullable`1[System.Drawing.Color],System.Nullable`1[System.Drawing.Color])",
    SelectedTypeName="Objects.Other.RenderMaterial",
    UseSchemaTag=False,
    UserSetSchemaTag=False,
    seed="3afbf71f6b7a8259aeed")
pipeline_3 = GeometryPipeline(
    GroupByLayer=False,
    GroupByType=False,
    IncludeHidden=True,
    IncludeLocked=True,
    LayerFilter="entities::residential",
    NameFilter="*",
    SublayerFiltering=True,
    TypeFilter=1073741848)
eso = ExtendSpeckleObject(SpeckleObject=pipeline_3, RenderMaterial=sso_4, selectedKitName="Objects")

colour_5 = ColourPicker(PickedColour=RGB(153, 54, 103))
sso_5 = RenderMaterial(
    Opacity=1,
    Metalness=0,
    Roughness=1,
    Diffuse=colour_5,
    SelectedConstructorName="Objects.Other.RenderMaterial.ctor(System.Double,System.Double,System.Double,System.Nullable`1[System.Drawing.Color],System.Nullable`1[System.Drawing.Color])",
    SelectedTypeName="Objects.Other.RenderMaterial",
    UseSchemaTag=False,
    UserSetSchemaTag=False,
    seed="722442b2e689257fa0dc")
pipeline_4 = GeometryPipeline(
    GroupByLayer=False,
    GroupByType=False,
    IncludeHidden=True,
    IncludeLocked=True,
    LayerFilter="entities::retail",
    NameFilter="*",
    SublayerFiltering=True,
    TypeFilter=1073741848)
eso_2 = ExtendSpeckleObject(SpeckleObject=pipeline_4, RenderMaterial=sso_5, selectedKitName="Objects")

colour_6 = ColourPicker(PickedColour=RGB(242, 242, 242))
sso_6 = RenderMaterial(
    Opacity=Slider(0.5, range=0..1),
    Metalness=0,
    Roughness=1,
    Diffuse=colour_6,
    SelectedConstructorName="Objects.Other.RenderMaterial.ctor(System.Double,System.Double,System.Double,System.Nullable`1[System.Drawing.Color],System.Nullable`1[System.Drawing.Color])",
    SelectedTypeName="Objects.Other.RenderMaterial",
    UseSchemaTag=False,
    UserSetSchemaTag=False,
    seed="268cca224f155a6be6a5")
pipeline_5 = GeometryPipeline(
    GroupByLayer=False,
    GroupByType=False,
    IncludeHidden=True,
    IncludeLocked=True,
    LayerFilter="context::surrounding",
    NameFilter="*",
    SublayerFiltering=True,
    TypeFilter=1073741848)
eso_3 = ExtendSpeckleObject(SpeckleObject=pipeline_5, RenderMaterial=sso_6, selectedKitName="Objects")

colour_7 = ColourPicker(PickedColour=RGB(61, 130, 153))
sso_7 = RenderMaterial(
    Opacity=1,
    Metalness=0,
    Roughness=1,
    Diffuse=colour_7,
    SelectedConstructorName="Objects.Other.RenderMaterial.ctor(System.Double,System.Double,System.Double,System.Nullable`1[System.Drawing.Color],System.Nullable`1[System.Drawing.Color])",
    SelectedTypeName="Objects.Other.RenderMaterial",
    UseSchemaTag=False,
    UserSetSchemaTag=False,
    seed="8fe254c2eb238868a0fd")
pipeline_6 = GeometryPipeline(
    GroupByLayer=False,
    GroupByType=False,
    IncludeHidden=True,
    IncludeLocked=True,
    LayerFilter="entities::parking",
    NameFilter="*",
    SublayerFiltering=True,
    TypeFilter=1073741848)
eso_4 = ExtendSpeckleObject(SpeckleObject=pipeline_6, RenderMaterial=sso_7, selectedKitName="Objects")

colour_8 = ColourPicker(PickedColour=RGBA(255, 255, 255, 128))
sso_8 = RenderMaterial(
    Opacity=Slider(0.5, range=0..1),
    Metalness=0,
    Roughness=1,
    Diffuse=colour_8,
    SelectedConstructorName="Objects.Other.RenderMaterial.ctor(System.Double,System.Double,System.Double,System.Nullable`1[System.Drawing.Color],System.Nullable`1[System.Drawing.Color])",
    SelectedTypeName="Objects.Other.RenderMaterial",
    UseSchemaTag=False,
    UserSetSchemaTag=False,
    seed="032ade27b4451b932559")
pipeline_7 = GeometryPipeline(
    GroupByLayer=False,
    GroupByType=False,
    IncludeHidden=True,
    IncludeLocked=True,
    LayerFilter="context::sidewalks",
    NameFilter="*",
    SublayerFiltering=True,
    TypeFilter=1073741848)
eso_5 = ExtendSpeckleObject(SpeckleObject=pipeline_7, RenderMaterial=sso_8, selectedKitName="Objects")

panel_3 = Panel("""displayValue
entityId
type
use
name""")

edges = BrepEdges(Brep=geo_8)  # -> Naked, Interior, NonManifold
eso_6 = ExtendSpeckleObject(SpeckleObject=geo_8, RenderMaterial=sso, selectedKitName="Objects")
merge = Merge(Data1=edges.Interior, Data2=eso_6)  # -> flatten(Result)
merge_2 = Merge(Data1=c_script_7, Data2="space", Data3="residential")
sg = SpeckleGroup(Objects=merge)
merge_3 = Merge(Data1=sg, Data2=merge_2, Data3="BuildingA.Residential")
csokv = CreateSpeckleObjectByKeyValue(Keys=panel_3, Values=merge_3, selectedKitName="Objects")

edges_2 = BrepEdges(Brep=geo_7)  # -> Naked, Interior, NonManifold
eso_7 = ExtendSpeckleObject(SpeckleObject=geo_7, RenderMaterial=sso, selectedKitName="Objects")
merge_4 = Merge(Data1=edges_2.Interior, Data2=eso_7)  # -> flatten(Result)
merge_5 = Merge(Data1=c_script_6, Data2="space", Data3="residential")
sg_2 = SpeckleGroup(Objects=merge_4)
merge_6 = Merge(Data1=sg_2, Data2=merge_5, Data3="BuildingB.Residential")
csokv_2 = CreateSpeckleObjectByKeyValue(Keys=panel_3, Values=merge_6, selectedKitName="Objects")

edges_3 = BrepEdges(Brep=geo_6)  # -> Naked, Interior, NonManifold
eso_8 = ExtendSpeckleObject(SpeckleObject=geo_6, RenderMaterial=sso_3, selectedKitName="Objects")
merge_7 = Merge(Data1=edges_3.Interior, Data2=eso_8)  # -> flatten(Result)
merge_8 = Merge(Data1="space", Data2="retail", Data3="retail")
sg_3 = SpeckleGroup(Objects=merge_7)
merge_9 = Merge(Data1=sg_3, Data2=merge_8, Data3="BuildingB.Retail")
csokv_3 = CreateSpeckleObjectByKeyValue(Keys=panel_3, Values=merge_9, selectedKitName="Objects")

edges_4 = BrepEdges(Brep=geo_5)  # -> Naked, Interior, NonManifold
eso_9 = ExtendSpeckleObject(SpeckleObject=geo_5, RenderMaterial=sso_3, selectedKitName="Objects")
merge_10 = Merge(Data1=edges_4.Interior, Data2=eso_9)  # -> flatten(Result)
merge_11 = Merge(Data1=c_script_4, Data2="space", Data3="retail")
sg_4 = SpeckleGroup(Objects=merge_10)
merge_12 = Merge(Data1=sg_4, Data2=merge_11, Data3="BuildingA.Retail")
csokv_4 = CreateSpeckleObjectByKeyValue(Keys=panel_3, Values=merge_12, selectedKitName="Objects")

edges_5 = BrepEdges(Brep=geo_4)  # -> Naked, Interior, NonManifold
eso_10 = ExtendSpeckleObject(SpeckleObject=geo_4, RenderMaterial=sso_2, selectedKitName="Objects")
merge_13 = Merge(Data1=edges_5.Interior, Data2=eso_10)  # -> flatten(Result)
merge_14 = Merge(Data1=c_script_3, Data2="space", Data3="parking")
sg_5 = SpeckleGroup(Objects=merge_13)
merge_15 = Merge(Data1=sg_5, Data2=merge_14, Data3="BuildingA.Parking")
csokv_5 = CreateSpeckleObjectByKeyValue(Keys=panel_3, Values=merge_15, selectedKitName="Objects")

edges_6 = BrepEdges(Brep=geo_3)  # -> Naked, Interior, NonManifold
eso_11 = ExtendSpeckleObject(SpeckleObject=geo_3, RenderMaterial=sso_2, selectedKitName="Objects")
merge_16 = Merge(Data1=edges_6.Interior, Data2=eso_11)  # -> flatten(Result)
merge_17 = Merge(Data1=c_script_2, Data2="space", Data3="parking")
sg_6 = SpeckleGroup(Objects=merge_16)
merge_18 = Merge(Data1=sg_6, Data2=merge_17, Data3="BuildingB.Parking")
csokv_6 = CreateSpeckleObjectByKeyValue(Keys=panel_3, Values=merge_18, selectedKitName="Objects")

edges_7 = BrepEdges(Brep=geo_2)  # -> Naked, Interior, NonManifold
eso_12 = ExtendSpeckleObject(SpeckleObject=geo_2, RenderMaterial=sso_2, selectedKitName="Objects")
merge_19 = Merge(Data1=edges_7.Interior, Data2=eso_12)  # -> flatten(Result)
merge_20 = Merge(Data1=c_script, Data2="space", Data3="parking")
sg_7 = SpeckleGroup(Objects=merge_19)
merge_21 = Merge(Data1=sg_7, Data2=merge_20, Data3="Complex.Parking")
csokv_7 = CreateSpeckleObjectByKeyValue(Keys=panel_3, Values=merge_21, selectedKitName="Objects")

merge_22 = Merge(Data1=csokv_2, Data2=csokv_3, Data3=csokv_6)
merge_23 = Merge(Data1=csokv, Data2=csokv_4, Data3=csokv_5)  # -> flatten(Result)

c_script_8 = CSharpScript()  # -> A; same code as c_script

c_script_9 = CSharpScript()  # -> A; same code as c_script

c_script_10 = CSharpScript()  # -> A
# ---------- c_script_10: C# ----------
A = null;
# ---------- end c_script_10 ----------
merge_24 = Merge(Data1=c_script_10, Data2=c_script_9, Data3="space", Data4="mixed", Data5="BuildingB")
csokv_8 = CreateSpeckleObjectByKeyValue(Keys=panel_3, Values=merge_24, selectedKitName="Objects")

geo_9 = Geometry(pipeline_5)
c_script_11 = CSharpScript()  # -> A; same code as c_script_10
preview = CustomPreview(Geometry=pipeline_7, Material=colour_8)
preview_2 = CustomPreview(
    Geometry=geo_9,
    Material={diffuse=RGB(228, 178, 227), emission=RGB(68, 53, 68), shine=0.5, specular=RGB(255, 254, 254), transparency=0})
edges_8 = BrepEdges(Brep=pipeline_5)  # -> Naked, Interior, NonManifold
preview_3 = CustomPreview(Geometry=pipeline_4, Material=colour_5)
hsv = ColourHSV(Alpha=1, Hue=0, Saturation=0, Value=0)
edges_9 = BrepEdges(Brep=pipeline_7)  # -> Naked, Interior, NonManifold
edges_10 = BrepEdges(Brep=pipeline_3)  # -> Naked, Interior, NonManifold
edges_11 = BrepEdges(Brep=pipeline_4)  # -> Naked, Interior, NonManifold
edges_12 = BrepEdges(Brep=pipeline_6)  # -> Naked, Interior, NonManifold
preview_4 = CustomPreview(Geometry=pipeline_6, Material=colour_7)
preview_5 = CustomPreview(Geometry=pipeline_3, Material=colour_4)
hsv_2 = ColourHSV(Alpha=1, Hue=0, Saturation=0, Value=0)
merge_25 = Merge(Data1=c_script_11, Data2=c_script_8, Data3="space", Data4="mixed", Data5="BuildingA")
geo_10 = Geometry(flatten(edges_9.Interior))
hsv_3 = ColourHSV(Alpha=1, Hue=0, Saturation=0, Value=0)
geo_11 = Geometry(flatten(edges_8.Interior))
geo_12 = Geometry(flatten(edges_10.Interior))
geo_13 = Geometry(flatten(edges_11.Interior))
geo_14 = Geometry(flatten(edges_12.Interior))
preview_6 = CustomPreview(Geometry=edges_8.Interior, Material=hsv)
hsv_4 = ColourHSV(Alpha=1, Hue=0, Saturation=0, Value=0)
hsv_5 = ColourHSV(Alpha=1, Hue=0, Saturation=0, Value=0)
csokv_9 = CreateSpeckleObjectByKeyValue(Keys=panel_3, Values=merge_25, selectedKitName="Objects")
preview_7 = CustomPreview(Geometry=geo_13, Material=hsv_3)
preview_8 = CustomPreview(Geometry=geo_10, Material=hsv_2)
preview_9 = CustomPreview(Geometry=geo_14, Material=hsv_4)
preview_10 = CustomPreview(Geometry=geo_12, Material=hsv_5)
c_script_12 = CSharpScript()  # -> A; same code as c_script
c_script_13 = CSharpScript()  # -> A; same code as c_script
c_script_14 = CSharpScript()  # -> A; same code as c_script
c_script_15 = CSharpScript()  # -> A; same code as c_script
c_script_16 = CSharpScript()  # -> A; same code as c_script
c_script_17 = CSharpScript()  # -> A; same code as c_script
c_script_18 = CSharpScript()  # -> A; same code as c_script
cso = CreateSpeckleObject(Geometry=graft(eso_2), EntityId=graft([c_script_13, c_script_12]), selectedKitName="Objects")  # -> flatten(SpeckleObject)
cso_2 = CreateSpeckleObject(Geometry=graft(eso), EntityId=graft([c_script_15, c_script_14]), selectedKitName="Objects")  # -> flatten(SpeckleObject)
cso_3 = CreateSpeckleObject(Geometry=graft(eso_4), EntityId=graft([c_script_17, c_script_16, c_script_18]), selectedKitName="Objects")  # -> flatten(SpeckleObject)
merge_26 = Merge(Data1=csokv_8, Data2=csokv_8, Data3=csokv_8)
merge_27 = Merge(Data1=csokv_9, Data2=csokv_9, Data3=csokv_9)
merge_28 = Merge(Data1="spatiallyContains", Data2="spatiallyContains", Data3="spatiallyContains")
merge_29 = Merge(Data1="spatiallyContains", Data2="spatiallyContains", Data3="spatiallyContains")
merge_30 = Merge(Data1=eso_5, Data2=eso_3, Data3=[geo_11, geo_10])
sg_8 = SpeckleGroup(Objects=merge_30)
cra = CreateRangekeeperAssembly(AssemblyName="BuildingA", Type="building", TargetSpeckleObjects=merge_23, RelationshipTypes=merge_29)
cra_2 = CreateRangekeeperAssembly(AssemblyName="BuildingB", Type="building", TargetSpeckleObjects=merge_22, RelationshipTypes=merge_28)
cso_4 = CreateSpeckleObject(Geometry=sg_8, selectedKitName="Objects")
dso = DeconstructSpeckleObject(SpeckleObject=cra, selectedKitName="Objects")  # -> Entities, EntityId, EntityIds, Name, Relationships, Type
merge_31 = Merge(Data1=flatten(cso_4))
merge_32 = Merge(Data1=cra, Data2=cra_2, Data3=csokv_7)

c_script_19 = CSharpScript()  # -> A; same code as c_script

c_script_20 = CSharpScript()  # -> A; same code as c_script_10
merge_33 = Merge(Data1=c_script_20, Data2=c_script_19, Data3="space", Data4="mixed", Data5="Complex")
csokv_10 = CreateSpeckleObjectByKeyValue(Keys=panel_3, Values=merge_33, selectedKitName="Objects")

c_script_21 = CSharpScript(x=dso.Entities)  # -> O; inputs x: list
# ---------- c_script_21: C# usings ----------
using System.Linq;
# ---------- c_script_21: C# ----------
var list = new List<object>();
list.Add(x[0]);

//foreach (object item in x)
//{
//    list.Add(item);
//}
O = x[0];
# ---------- end c_script_21 ----------
panel_4 = Panel(c_script_21)
merge_34 = Merge(Data1=csokv_10, Data2=csokv_10, Data3=csokv_10)
merge_35 = Merge(Data1="spatiallyContains", Data2="spatiallyContains", Data3="spatiallyContains")
cra_3 = CreateRangekeeperAssembly(AssemblyName="Complex", Type="building", TargetSpeckleObjects=merge_32, RelationshipTypes=merge_35)

list = Accounts(
    {"No account selected": , "Account (danfink@mit.edu | https://speckle.xyz)": "3865a09189"}, selected="Account (danfink@mit.edu | https://speckle.xyz)",
    selectedId="3865a09189",
    selectedServer="https://speckle.xyz")
screate = CreateStream(SpeckleAccount=list, stream="3f40d86240 https://speckle.xyz 3865a09189")
send = Send(
    Stream=screate,
    Context=cso_4,
    Scenario=cra_3,
    AutoSend=False,
    BaseId="8d3fcff5ec2a41a9c216feebe2ad8f5d",
    CurrentComponentState="expired",
    KitName="Objects",
    OutputWrappers="https://speckle.xyz\t3f40d86240\td5930913d6",
    UseDefaultCache=True,
    selectedKitName="Objects")
panel_5 = Panel(send)

dso_2 = DeconstructSpeckleObject(SpeckleObject=cra_3, selectedKitName="Objects")  # -> Entities, EntityId, EntityIds, Name, Relationships, Type
