# Grasshopper definition speckleGHTest.ghx (Grasshopper 1.0.7)
# plug-ins: Speckle 2, Rangekeeper

receive = Receive(
    Stream="https://speckle.xyz/streams/1dd7d041b5/commits/6f1073c032",
    AutoReceive=False,
    CurrentComponentState="expired",
    ExpandOutput=True,
    ReceiveOnOpen=False,
    ReceivedCommitId="6f1073c032",
    StreamWrapper="https://speckle.xyz/streams/1dd7d041b5/commits/6f1073c032",
    selectedKitName="None")  # -> Info, Data
panel = Panel(receive.Data)
item = ListItem(List=receive.Data, Index=0, Wrap=True)  # -> Item, Item1
esokv = ExtendSpeckleObjectByKeyValue(SpeckleObject=item.Item, Keys="entityId", Values="12345", selectedKitName="Objects")
esokv_2 = ExtendSpeckleObjectByKeyValue(SpeckleObject=item.Item, Keys="entityId", Values="54321", selectedKitName="Objects")
cra = CreateRangekeeperAssembly(
    AssemblyName="foo",
    AssemblyType="foo",
    SourceSpeckleObjects=esokv,
    TargetSpeckleObjects=esokv_2,
    RelationshipTypes="bar")
panel_2 = Panel(cra)
cra_2 = CreateRangekeeperAssembly(
    AssemblyName="quux",
    AssemblyType="quux",
    SourceSpeckleObjects=cra,
    TargetSpeckleObjects=esokv_2,
    RelationshipTypes="baz")
sg = SpeckleGroup(Objects=cra)
dso = DeconstructSpeckleObject(SpeckleObject=cra, selectedKitName="Objects")  # -> AssemblyType, CollectionType, Elements, EntityId, EntityIds, Name, Relationships
dso_2 = DeconstructSpeckleObject(SpeckleObject=sg, selectedKitName="Objects")
sovk = SpeckleObjectValueByKey(Object=cra, Key="elements", selectedKitName="Objects")
esokv_3 = ExtendSpeckleObjectByKeyValue(SpeckleObject=cra, Keys="foo", Values="bar", selectedKitName="Objects")
dso_3 = DeconstructSpeckleObject(SpeckleObject=cra_2, selectedKitName="Objects")  # -> A, AssemblyType, CollectionType, Elements, EntityId, EntityIds, Name, Relationships
sok = SpeckleObjectKeys(SpeckleObject=cra, perObject=True)
eso = ExtendSpeckleObject(SpeckleObject=cra_2, A="bar", selectedKitName="Objects")
panel_3 = Panel(sok)
dso_4 = DeconstructSpeckleObject(SpeckleObject=eso, selectedKitName="Objects")  # -> A, AssemblyType, CollectionType, Elements, EntityId, EntityIds, Name, Relationships
panel_4 = Panel(dso.EntityId)
panel_5 = Panel(dso_3.Elements)
send = Send(
    Stream="https://speckle.xyz/streams/1dd7d041b5",
    Data=cra,
    AutoSend=False,
    BaseId="ef65207b988a5802543bfd849e04d95d",
    CurrentComponentState="expired",
    KitName="Objects",
    OutputWrappers="https://speckle.xyz\t1dd7d041b5\t684abcb278",
    UseDefaultCache=True,
    selectedKitName="Objects")
panel_6 = Panel(send)
panel_7 = Panel(dso_4.EntityId)
panel_8 = Panel(dso_4.EntityIds)
panel_9 = Panel(dso_4.Elements)
