# Grasshopper definition exampleDesignCanonical.ghx (Grasshopper 1.0.8)
# plug-ins: Rangekeeper.Components

panel = Panel("""-5.9
-2.8
0.3
5.3
8.4
11.5
14.6
17.7
20.8
23.9
27.0
30.1
33.2
36.3
39.4
42.5
45.6
48.7
51.8
54.9
58.0
61.1
64.2""")
design = RKExampleDesign(RhinoSource="exampleDesign.3dm", FloorElevations=panel)  # -> Model, Associations
export = RKCanonicalExport(Model=design.Model, GeometryAssociations=design.Associations)  # -> ModelJSON, Envelope
validate = RKValidateModel(Model=design.Model)  # -> Valid, Diagnostics
