# Grasshopper definition genericAuthoring.ghx (Grasshopper 1.0.8)
# plug-ins: Rangekeeper.Components

defs = RKDefinitions(JSON="{}")
entity = RKEntity(JSON="{\"name\":\"Second\"}")
model = RKModel(Definitions=defs, Entities=entity, RKContent="3C72726C157332437AAE4DB6E3E3C4D23786A9AF87C3682EB833DF952B0E6FD5")
export = RKCanonicalExport(Model=model, GeometryAssociations="[]")  # -> ModelJSON, Envelope
