# Grasshopper definition exampleDesignConfig.ghx (Grasshopper 1.0.7)
# plug-ins: Components, Rangekeeper, eleFront, Speckle 2

# ---- group: FFL Zs
number_slider = Slider(0, range=0..100)
series = Series(Start=0, Step=Slider(3.1, range=0..10), Count=Slider(20, range=0..100))
merge = Merge(Data1=Slider(6.2, range=0..10), Data2=Slider(3.1, range=0..10))
addition = Addition(A=series, B=Slider(5, range=0..10))
neg = Negative(Value=merge)
ins = InsertItems(List=addition, Item=number_slider, Indices=number_slider, Wrap=True)
ins_2 = InsertItems(List=ins, Item=neg, Indices=number_slider, Wrap=True)
addition_2 = Addition(A=ins_2, B=Slider(0.3, range=0..1))

# ----
reflay = ReferenceByLayer(LayerName="complex::*", lightweight=False)

pt = ConstructPoint(XCoordinate=0, YCoordinate=0, ZCoordinate=addition_2)
xy = XYPlane(Origin=pt)
contour = ContourEx(Shape=simplify(graft(reflay)), Plane=xy, Distances=Slider(0, range=0..100))
data = Data(simplify(graft(reflay)))
clean = CleanTree(RemoveNulls=True, RemoveInvalid=True, RemoveEmpty=True, Tree=contour)
path_mapper = PathMapper(clean, source="{A;B;C;D;E}", target="{C}")
boundary = BoundarySurfaces(Edges=path_mapper)
cso = CreateSpeckleObject(Geometry=data, selectedKitName="Objects")
getuv = GetUserValue(Geometry=data, Key="type")  # -> simplify(Values)
area = Area(Geometry=boundary)  # -> Area, Centroid
rhatt = GetRhinoAttributes(Geometry=data, fullpath=False)  # -> Name, Layer, Color, MaterialName, SourceFile
pdecon = Deconstruct(Point=area.Centroid)  # -> XComponent, YComponent, ZComponent
split = TextSplit(Text=rhatt.Layer, Separators=" ")
txt = Text(flatten(pdecon.ZComponent))
item = ListItem(List=split, Index=0, Wrap=True)  # -> Item1, Item
tmatch = MatchText(Text=graft(txt), Pattern=addition_2, Case=True)
split_2 = TextSplit(Text=item.Item1, Separators="::")
mindex = MemberIndex(Set=tmatch, Member=Toggle(True))  # -> flatten(Index), Count
item_2 = ListItem(List=simplify(split_2), Index=0, Wrap=True)  # -> Item1, Item, Item1_2, Item2
unflatten = UnflattenTree(Tree=mindex.Index, Guide=pdecon.ZComponent)
subtraction = Subtraction(A=unflatten, B=Slider(2, range=0..10))
case = TextCase(Text="Floor", Culture=127)  # -> UpperCase, LowerCase
crossref = CrossReference(ListA="Floor", ListB=subtraction, CrossMode=1)  # -> ListA, ListB
merge_2 = Merge(Data1=item_2.Item2, Data2=item_2.Item1)
merge_3 = Merge(Data1=graft(crossref.ListA), Data2=graft(crossref.ListB))
join = TextJoin(Text=merge_2)  # -> simplify(Result)
join_2 = TextJoin(Text=merge_3)
pshift = ShiftPaths(Data=join_2, Offset=-1)
crossref_2 = CrossReference(ListA=join, ListB=pshift, CrossMode=1)  # -> ListA, ListB
merge_4 = Merge(Data1=graft(crossref_2.ListA), Data2=graft(crossref_2.ListB))
cso_2 = CreateSpeckleObject(Geometry=boundary, selectedKitName="Objects")
join_3 = TextJoin(Text=merge_4)
pshift_2 = ShiftPaths(Data=join_3, Offset=-1)
crke = CreateRangekeeperEntity(SpeckleObject=cso_2)
crke_2 = CreateRangekeeperEntity(SpeckleObject=cso)
eso = ExtendSpeckleObject(SpeckleObject=crke_2, Name=join, Type=getuv, selectedKitName="Objects")
eso_2 = ExtendSpeckleObject(
    SpeckleObject=crke,
    Name=pshift_2,
    Type=case.LowerCase,
    FloorFFL=pdecon.ZComponent,
    FloorGFA=area.Area,
    FloorNum=subtraction,
    selectedKitName="Objects")
crossref_3 = CrossReference(ListA=eso, ListB=eso_2, CrossMode=1)  # -> ListA, ListB
crka = CreateRangekeeperAssembly(SourceEntities=crossref_3.ListA, TargetEntities=crossref_3.ListB, RelationshipTypes="contains")
cset = CreateSet(List=flatten(item_2.Item2))  # -> Set, Map
eso_3 = ExtendSpeckleObject(SpeckleObject=crka, Name=join, Type="compartment", selectedKitName="Objects")
dso = DeconstructSpeckleObject(SpeckleObject=eso_3, selectedKitName="Objects")  # -> Entities, EntityId, Name, Relationships, Type
dso_2 = DeconstructSpeckleObject(SpeckleObject=crka, selectedKitName="Objects")  # -> Entities, EntityId, Relationships
arkp = AddPropertiesToARangekeeperEntity(Entity=<missing>, Attributes=<missing>, Measurements=<missing>)
arkp_2 = AddPropertiesToARangekeeperEntity(Entity=<missing>, Attributes=<missing>, Measurements=<missing>)
decompose_list = DecomposeList(O=dso_2.Relationships)  # -> A
# ---------- decompose_list: C# ----------
    A = O;
# ---------- end decompose_list ----------
dso_3 = DeconstructSpeckleObject(SpeckleObject=decompose_list, selectedKitName="Objects")  # -> Source, Target, TargetId, Type
tmatch_2 = MatchText(Text=dso.Name, RegEx=cset.Set, Case=True)  # -> simplify(Match)
flip = FlipMatrix(Data=tmatch_2)
cso_3 = CreateSpeckleObject(Name=cset.Set, Type="building", selectedKitName="Objects")
pshift_3 = ShiftPaths(Data=dso_3.TargetId, Offset=-1)
ar = AddRelationshipsToARangekeeperAssembly(
    Assembly=<missing>,
    SourceRangekeeperEntities=<missing>,
    TargetRangekeeperEntities=<missing>,
    RelationshipTypes=<missing>)
cset_2 = CreateSet(List=pshift_3)  # -> Set, Map
crke_3 = CreateRangekeeperEntity(SpeckleObject=cso_3)
sift = SiftPattern(List=flatten(eso_3), SiftPattern=flip)  # -> Output0, Output1
clean_2 = CleanTree(RemoveNulls=True, RemoveInvalid=True, RemoveEmpty=False, Tree=sift.Output1)
cso_4 = CreateSpeckleObject(Name="development", Type="development", selectedKitName="Objects")
crossref_4 = CrossReference(ListA=simplify(graft(crke_3)), ListB=clean_2, CrossMode=1)  # -> ListA, ListB
panel = Panel(clean_2)
crke_4 = CreateRangekeeperEntity(SpeckleObject=cso_4)
ar_2 = AddRelationshipsToARangekeeperAssembly(Assembly=<missing>, TargetRangekeeperEntities=<missing>, RelationshipTypes=<missing>)
crka_2 = CreateRangekeeperAssembly(SourceEntities=crossref_4.ListA, TargetEntities=crossref_4.ListB, RelationshipTypes="contains")
crossref_5 = CrossReference(ListA=simplify(graft(crke_4)), ListB=crka_2, CrossMode=1)  # -> ListA, ListB
decompose_list_2 = DecomposeList(O=crka_2)  # -> A; same code as decompose_list
crka_3 = CreateRangekeeperAssembly(SourceEntities=crossref_5.ListA, TargetEntities=crossref_5.ListB, RelationshipTypes="contains")
dso_4 = DeconstructSpeckleObject(SpeckleObject=decompose_list_2, selectedKitName="Objects")  # -> Entities, EntityId, Relationships
list = Accounts(
    {"No account selected": , "Account (danfink@mit.edu | https://speckle.xyz)": "3865a09189"}, selected="Account (danfink@mit.edu | https://speckle.xyz)",
    selectedId="3865a09189",
    selectedServer="https://speckle.xyz")
decompose_list_3 = DecomposeList(O=dso_4.Relationships)  # -> A; same code as decompose_list
dso_5 = DeconstructSpeckleObject(SpeckleObject=decompose_list_3, selectedKitName="Objects")  # -> Source, Target, Type
screate = CreateStream(SpeckleAccount=list, stream="f5e306e3fa https://speckle.xyz 3865a09189")
panel_2 = Panel(crossref_5.ListB)
sup = StreamUpdate(Stream=screate, Name="RangekeeperDemo", Public=True)
ar_3 = AddRelationshipsToARangekeeperAssembly(
    Assembly=<missing>,
    SourceRangekeeperEntities=<missing>,
    TargetRangekeeperEntities=<missing>,
    RelationshipTypes=<missing>)  # -> flatten(Assembly)
ar_4 = AddRelationshipsToARangekeeperAssembly(Assembly=<missing>, TargetRangekeeperEntities=ar_3, RelationshipTypes=<missing>)
