# Grasshopper definition unnamed.gh (Grasshopper 1.0.7)

panel = Panel("""Nodes: 
X:116.8785, Y:-41.3261, Z:14.3000: start: X:116.8785, Y:-41.3261, Z:14.3000, end: X:99.8785, Y:-41.3261, Z:14.3000 | start: X:116.8785, Y:-41.3261, Z:14.3000, end: X:116.8785, Y:-41.3261, Z:5.0000
X:99.8785, Y:-41.3261, Z:14.3000: start: X:116.8785, Y:-41.3261, Z:14.3000, end: X:99.8785, Y:-41.3261, Z:14.3000 | start: X:99.8785, Y:-41.3261, Z:8.1000, end: X:99.8785, Y:-41.3261, Z:14.3000
X:99.8785, Y:-41.3261, Z:8.1000: start: X:99.8785, Y:-41.3261, Z:8.1000, end: X:99.8785, Y:-41.3261, Z:14.3000 | start: X:99.8785, Y:-41.3261, Z:8.1000, end: X:99.8785, Y:-41.3261, Z:5.0000
X:99.8785, Y:-41.3261, Z:5.0000: start: X:99.8785, Y:-41.3261, Z:8.1000, end: X:99.8785, Y:-41.3261, Z:5.0000 | start: X:116.8785, Y:-41.3261, Z:5.0000, end: X:99.8785, Y:-41.3261, Z:5.0000
X:116.8785, Y:-41.3261, Z:5.0000: start: X:116.8785, Y:-41.3261, Z:5.0000, end: X:99.8785, Y:-41.3261, Z:5.0000 | start: X:116.8785, Y:-41.3261, Z:14.3000, end: X:116.8785, Y:-41.3261, Z:5.0000

Begin While Loop

Current: 
start: X:116.8785, Y:-41.3261, Z:14.3000, end: X:99.8785, Y:-41.3261, Z:14.3000
Nodes: 
X:99.8785, Y:-41.3261, Z:14.3000: start: X:116.8785, Y:-41.3261, Z:14.3000, end: X:99.8785, Y:-41.3261, Z:14.3000 | start: X:99.8785, Y:-41.3261, Z:8.1000, end: X:99.8785, Y:-41.3261, Z:14.3000
X:99.8785, Y:-41.3261, Z:8.1000: start: X:99.8785, Y:-41.3261, Z:8.1000, end: X:99.8785, Y:-41.3261, Z:14.3000 | start: X:99.8785, Y:-41.3261, Z:8.1000, end: X:99.8785, Y:-41.3261, Z:5.0000
X:99.8785, Y:-41.3261, Z:5.0000: start: X:99.8785, Y:-41.3261, Z:8.1000, end: X:99.8785, Y:-41.3261, Z:5.0000 | start: X:116.8785, Y:-41.3261, Z:5.0000, end: X:99.8785, Y:-41.3261, Z:5.0000
X:116.8785, Y:-41.3261, Z:5.0000: start: X:116.8785, Y:-41.3261, Z:5.0000, end: X:99.8785, Y:-41.3261, Z:5.0000 | start: X:116.8785, Y:-41.3261, Z:14.3000, end: X:116.8785, Y:-41.3261, Z:5.0000
Ordered: 
start: X:116.8785, Y:-41.3261, Z:14.3000, end: X:99.8785, Y:-41.3261, Z:14.3000
Nexts: 	start: X:116.8785, Y:-41.3261, Z:14.3000, end: X:99.8785, Y:-41.3261, Z:14.3000 | start: X:99.8785, Y:-41.3261, Z:8.1000, end: X:99.8785, Y:-41.3261, Z:14.3000
Next pre-parsing: 	start: X:116.8785, Y:-41.3261, Z:14.3000, end: X:99.8785, Y:-41.3261, Z:14.3000
Next post-parsing: 	start: X:99.8785, Y:-41.3261, Z:14.3000, end: X:116.8785, Y:-41.3261, Z:14.3000
Adding Next...
Nodes: 
X:99.8785, Y:-41.3261, Z:8.1000: start: X:99.8785, Y:-41.3261, Z:8.1000, end: X:99.8785, Y:-41.3261, Z:14.3000 | start: X:99.8785, Y:-41.3261, Z:8.1000, end: X:99.8785, Y:-41.3261, Z:5.0000
X:99.8785, Y:-41.3261, Z:5.0000: start: X:99.8785, Y:-41.3261, Z:8.1000, end: X:99.8785, Y:-41.3261, Z:5.0000 | start: X:116.8785, Y:-41.3261, Z:5.0000, end: X:99.8785, Y:-41.3261, Z:5.0000
X:116.8785, Y:-41.3261, Z:5.0000: start: X:116.8785, Y:-41.3261, Z:5.0000, end: X:99.8785, Y:-41.3261, Z:5.0000 | start: X:116.8785, Y:-41.3261, Z:14.3000, end: X:116.8785, Y:-41.3261, Z:5.0000
Ordered: 
start: X:116.8785, Y:-41.3261, Z:14.3000, end: X:99.8785, Y:-41.3261, Z:14.3000, start: X:99.8785, Y:-41.3261, Z:14.3000, end: X:116.8785, Y:-41.3261, Z:14.3000

Current: 
start: X:99.8785, Y:-41.3261, Z:14.3000, end: X:116.8785, Y:-41.3261, Z:14.3000
Nodes: 
X:99.8785, Y:-41.3261, Z:8.1000: start: X:99.8785, Y:-41.3261, Z:8.1000, end: X:99.8785, Y:-41.3261, Z:14.3000 | start: X:99.8785, Y:-41.3261, Z:8.1000, end: X:99.8785, Y:-41.3261, Z:5.0000
X:99.8785, Y:-41.3261, Z:5.0000: start: X:99.8785, Y:-41.3261, Z:8.1000, end: X:99.8785, Y:-41.3261, Z:5.0000 | start: X:116.8785, Y:-41.3261, Z:5.0000, end: X:99.8785, Y:-41.3261, Z:5.0000
X:116.8785, Y:-41.3261, Z:5.0000: start: X:116.8785, Y:-41.3261, Z:5.0000, end: X:99.8785, Y:-41.3261, Z:5.0000 | start: X:116.8785, Y:-41.3261, Z:14.3000, end: X:116.8785, Y:-41.3261, Z:5.0000
Ordered: 
start: X:116.8785, Y:-41.3261, Z:14.3000, end: X:99.8785, Y:-41.3261, Z:14.3000, start: X:99.8785, Y:-41.3261, Z:14.3000, end: X:116.8785, Y:-41.3261, Z:14.3000""")
geo = Geometry([<brep referenced from the Rhino model> x17])
txt = Text(panel)
rep = ReplaceText(Text=txt, Find=flatten("X:116.8785, Y:-41.3261, Z:14.3000"), Replace=flatten("A"), RecursiveReplace=False)
edges = BrepEdges(Brep=geo)  # -> Naked, Interior, NonManifold
cp = ControlPoints(Curve=geo)  # -> Points, Weights, Knots
rep_2 = ReplaceText(Text=rep, Find=flatten("X:99.8785, Y:-41.3261, Z:14.3000"), Replace=flatten("B"), RecursiveReplace=False)
bang = ExplodeTree(Data=cp.Points)  # -> Branch0, Branch1
item = ListItem(List=edges.Naked, Index=0, Wrap=True)  # -> Item, Item1, Item2, Item3
geo_2 = Geometry(item.Item3)
panel_2 = Panel(rep_2)
explode = Explode(Curve=geo_2, Recursive=True)  # -> Segments, Vertices
