# Grasshopper definition exampleDesignConfig.ghx (Grasshopper 1.0.7)
# plug-ins: eleFront, Speckle 2, Components

# ---- group: FFL Zs
number_slider = Slider(0, range=0..100)
series = Series(Start=0, Step=Slider(3.1, range=0..10), Count=Slider(20, range=0..100))
merge = Merge(Data1=Slider(6.2, range=0..10), Data2=Slider(3.1, range=0..10))
addition = Addition(A=series, B=Slider(5, range=0..10))
neg = Negative(Value=merge)
ins = InsertItems(List=addition, Item=number_slider, Indices=number_slider, Wrap=True)
ins_2 = InsertItems(List=ins, Item=neg, Indices=number_slider, Wrap=True)
addition_2 = Addition(A=ins_2, B=Slider(0.3, range=0..1))

# ----
reflay = ReferenceByLayer(LayerName="complex::*", lightweight=False)

pt = ConstructPoint(XCoordinate=0, YCoordinate=0, ZCoordinate=addition_2)
xy = XYPlane(Origin=pt)
contour = ContourEx(Shape=simplify(graft(reflay)), Plane=xy, Distances=Slider(0, range=0..100))
data = Data(simplify(graft(reflay)))
clean = CleanTree(RemoveNulls=True, RemoveInvalid=True, RemoveEmpty=True, Tree=contour)
path_mapper = PathMapper(clean, source="{A;B;C;D;E}", target="{C}")
edges = BrepEdges(Brep=data)  # -> Naked, Interior, NonManifold
pshift = ShiftPaths(Data=edges.Interior, Offset=-1)
boundary = BoundarySurfaces(Edges=path_mapper)
merge_2 = Merge(Data1=data, Data2=pshift)
graft = GraftTree(Tree=boundary, IncludeEmptyLists=True, IncludeNullItems=True)
getuv = GetUserValue(Geometry=data, Key="type")  # -> simplify(Values)
cso = CreateSpeckleObject(DisplayValue=merge_2, selectedKitName="Objects")
rhatt = GetRhinoAttributes(Geometry=data, fullpath=False)  # -> Name, Layer, Color, MaterialName, SourceFile
panel = Panel(data)
area = Area(Geometry=graft)  # -> Area, Centroid
pdecon = Deconstruct(Point=area.Centroid)  # -> XComponent, YComponent, ZComponent
split = TextSplit(Text=rhatt.Layer, Separators=" ")
txt = Text(flatten(pdecon.ZComponent))
item = ListItem(List=split, Index=0, Wrap=True)  # -> Item1, Item
tmatch = MatchText(Text=graft(txt), Pattern=addition_2, Case=True)
split_2 = TextSplit(Text=item.Item1, Separators="::")
mindex = MemberIndex(Set=tmatch, Member=Toggle(True))  # -> flatten(Index), Count
item_2 = ListItem(List=simplify(split_2), Index=0, Wrap=True)  # -> Item1, Item, Item1_2, Item2
unflatten = UnflattenTree(Tree=mindex.Index, Guide=pdecon.ZComponent)
subtraction = Subtraction(A=unflatten, B=Slider(2, range=0..10))
case = TextCase(Text="Floor", Culture=127)  # -> UpperCase, LowerCase
crossref = CrossReference(ListA="Floor", ListB=subtraction, CrossMode=1)  # -> ListA, ListB
merge_3 = Merge(Data1=item_2.Item2, Data2=item_2.Item1)
merge_4 = Merge(Data1=graft(crossref.ListA), Data2=graft(crossref.ListB))
join = TextJoin(Text=merge_3)  # -> simplify(Result)
edges_2 = BrepEdges(Brep=graft)  # -> Naked, Interior, NonManifold
join_2 = TextJoin(Text=merge_4)
pshift_2 = ShiftPaths(Data=edges_2.Naked, Offset=-1)  # disabled
pshift_3 = ShiftPaths(Data=join_2, Offset=-2)
merge_5 = Merge(Data1=graft, Data2=pshift_2)
crossref_2 = CrossReference(ListA=join, ListB=pshift_3, CrossMode=1)  # -> ListA, ListB
merge_6 = Merge(Data1=graft(crossref_2.ListA), Data2=graft(crossref_2.ListB))
cso_2 = CreateSpeckleObject(DisplayValue=merge_5, selectedKitName="Objects")
cset = CreateSet(List=flatten(item_2.Item2))  # -> Set, Map
join_3 = TextJoin(Text=merge_6)
crke = CreateRangekeeperEntity(SpeckleObject=cso_2)
crossref_3 = CrossReference(ListA=rhatt.Color, ListB=crke, CrossMode=1)  # -> ListA, ListB
sso = RenderMaterial(
    Opacity=Slider(1, range=0..1),
    Metalness=0,
    Roughness=1,
    Diffuse=crossref_3.ListA,
    Emissive=crossref_3.ListA,
    SelectedConstructorName="Objects.Other.RenderMaterial.ctor(System.Double,System.Double,System.Double,System.Nullable`1[System.Drawing.Color],System.Nullable`1[System.Drawing.Color])",
    SelectedTypeName="Objects.Other.RenderMaterial",
    UseSchemaTag=False,
    UserSetSchemaTag=False,
    seed="fdb7e44b0970af453b79")
sso_2 = RenderMaterial(
    Opacity=Slider(1, range=0..1),
    Metalness=Slider(0.5, range=0..1),
    Roughness=1,
    Diffuse=rhatt.Color,
    Emissive=rhatt.Color,
    SelectedConstructorName="Objects.Other.RenderMaterial.ctor(System.Double,System.Double,System.Double,System.Nullable`1[System.Drawing.Color],System.Nullable`1[System.Drawing.Color])",
    SelectedTypeName="Objects.Other.RenderMaterial",
    UseSchemaTag=False,
    UserSetSchemaTag=False,
    seed="c71a79b1a0588b06e21e")
crke_2 = CreateRangekeeperEntity(SpeckleObject=cso)
eso = ExtendSpeckleObject(SpeckleObject=crke_2, Name=join, Type=getuv, Use=item_2.Item1, RenderMaterial=sso_2, selectedKitName="Objects")
eso_2 = ExtendSpeckleObject(
    SpeckleObject=crke,
    Name=join_3,
    Type=case.LowerCase,
    Ffl=pdecon.ZComponent,
    Gfa=area.Area,
    Number=subtraction,
    RenderMaterial=sso,
    selectedKitName="Objects")
pshift_4 = ShiftPaths(Data=eso_2, Offset=-1)
tmatch_2 = MatchText(Text=getuv, Pattern="utilities", Case=True)
dispatch = Dispatch(List=pshift_4, DispatchPattern=tmatch_2)  # -> ListA, ListB
dispatch_2 = Dispatch(List=eso, DispatchPattern=tmatch_2)  # -> ListA, ListB
crossref_4 = CrossReference(ListA=dispatch_2.ListB, ListB=dispatch.ListB, CrossMode=1)  # -> ListA, ListB
clean_2 = CleanTree(RemoveNulls=True, RemoveInvalid=True, RemoveEmpty=True, Tree=crossref_4.ListA)
clean_3 = CleanTree(RemoveNulls=True, RemoveInvalid=True, RemoveEmpty=True, Tree=crossref_4.ListB)
clean_4 = CleanTree(RemoveNulls=True, RemoveInvalid=True, RemoveEmpty=True, Tree=dispatch_2.ListB)
item_3 = ListItem(Index=0, Wrap=True)
arkr = AddRelationships(Entity=clean_4, SourceEntities=clean_2, TargetEntities=clean_3, RelationshipTypes="spatiallyContains")
dso = DeconstructSpeckleObject(SpeckleObject=arkr, selectedKitName="Objects")  # -> DisplayValue, EntityId, Name, Relationships, RenderMaterial, Type, Use
decompose_list = DecomposeList(O=dso.Relationships)  # -> A
# ---------- decompose_list: C# ----------
    A = O;
# ---------- end decompose_list ----------
dso_2 = DeconstructSpeckleObject(SpeckleObject=decompose_list, selectedKitName="Objects")  # -> Source, Target, Type
get_c_type = GetCSharpType(O=dso_2.Source)  # -> A
# ---------- get_c_type: C# ----------
    A = O.GetType().ToString();
# ---------- end get_c_type ----------
decompose_keyvaluepair = DecomposeKeyValuePairStringObject(O=get_c_type)  # -> K, V
# ---------- decompose_keyvaluepair: C# ----------
    if (O != null)
    {
        var kvp = (System.Collections.Generic.KeyValuePair<string, object>) O;
        K = kvp.Key;
        V = kvp.Value;
    }
# ---------- end decompose_keyvaluepair ----------
dso_3 = DeconstructSpeckleObject(SpeckleObject=dso_2.Source, selectedKitName="Objects")  # -> DisplayValue, EntityId, Name, Relationships, RenderMaterial, Type, Use
decompose_list_2 = DecomposeList(O=get_c_type)  # -> A; same code as decompose_list
panel_2 = Panel(dispatch_2.ListA)

# ---- group: Sort By Bldg
clean_5 = CleanTree(RemoveNulls=True, RemoveInvalid=True, RemoveEmpty=True, Tree=dispatch_2.ListA)
dso_4 = DeconstructSpeckleObject(SpeckleObject=clean_5, selectedKitName="Objects")  # -> DisplayValue, EntityId, Name, RenderMaterial, Type, Use
tmatch_3 = MatchText(Text=dso_4.Name, RegEx=cset.Set, Case=True)  # -> simplify(Match)
flip = FlipMatrix(Data=tmatch_3)
sift = SiftPattern(List=flatten(clean_5), SiftPattern=flip)  # -> Output0, Output1
clean_6 = CleanTree(RemoveNulls=True, RemoveInvalid=True, RemoveEmpty=False, Tree=sift.Output1)

dso_5 = DeconstructSpeckleObject(SpeckleObject=arkr, selectedKitName="Objects")  # -> DisplayValue, EntityId, Name, Relationships, RenderMaterial, Type, Use
tmatch_4 = MatchText(Text=dso_5.Name, RegEx=cset.Set, Case=True)  # -> simplify(Match)
flip_2 = FlipMatrix(Data=tmatch_4)
sift_2 = SiftPattern(List=flatten(arkr), SiftPattern=flip_2)  # -> Output0, Output1
clean_7 = CleanTree(RemoveNulls=True, RemoveInvalid=True, RemoveEmpty=False, Tree=sift_2.Output1)

# ---- group: @context
reflay_2 = ReferenceByLayer(LayerName="context::surrounding", lightweight=False)

reflay_3 = ReferenceByLayer(LayerName="context::sidewalks", lightweight=False)

list = ValueList({"Point", "Curve", "Arc", "Circle", "Ellipse", "Line", "Polyline", "Brep", "Surface", "Polysurface", "Extrusion", "Block", "Text", "TextDot", "Dimension", "LinearDimension", "AngularDimension", "RadialDimension", "Hatch", "Leader"}, selected="Brep")
filtertype = FilterByType(ObjectType=list, Geometry=reflay_2, invertFilter=False, returnNulls=False)  # -> ExcludedGeometry, IncludedGeometry
filtertype_2 = FilterByType(ObjectType=list, Geometry=reflay_3, invertFilter=False, returnNulls=False)  # -> ExcludedGeometry, IncludedGeometry
edges_3 = BrepEdges(Brep=filtertype.IncludedGeometry)  # -> Naked, Interior, NonManifold
sso_3 = RenderMaterial(
    Opacity=1,
    Metalness=0,
    Roughness=1,
    Diffuse=ColourSwatch(SwatchColor=RGB(255, 255, 255)),
    SelectedConstructorName="Objects.Other.RenderMaterial.ctor(System.Double,System.Double,System.Double,System.Nullable`1[System.Drawing.Color],System.Nullable`1[System.Drawing.Color])",
    SelectedTypeName="Objects.Other.RenderMaterial",
    UseSchemaTag=False,
    UserSetSchemaTag=False,
    seed="f2d41b2587655c9f27c7")
sso_4 = RenderMaterial(
    Opacity=1,
    Metalness=0,
    Roughness=1,
    Diffuse=ColourSwatch(SwatchColor=RGB(242, 242, 242)),
    SelectedConstructorName="Objects.Other.RenderMaterial.ctor(System.Double,System.Double,System.Double,System.Nullable`1[System.Drawing.Color],System.Nullable`1[System.Drawing.Color])",
    SelectedTypeName="Objects.Other.RenderMaterial",
    UseSchemaTag=False,
    UserSetSchemaTag=False,
    seed="0848bf9666e16bbd08aa")
edges_4 = BrepEdges(Brep=filtertype_2.IncludedGeometry)  # -> Naked, Interior, NonManifold
pshift_5 = ShiftPaths(Data=edges_3.Interior, Offset=-1)
pshift_6 = ShiftPaths(Data=edges_4.Interior, Offset=-1)
merge_7 = Merge(Data1=filtertype.IncludedGeometry, Data2=pshift_5)
merge_8 = Merge(Data1=filtertype_2.IncludedGeometry, Data2=pshift_6)
eso_3 = ExtendSpeckleObject(SpeckleObject=merge_8, RenderMaterial=sso_4, selectedKitName="Objects")
eso_4 = ExtendSpeckleObject(SpeckleObject=merge_7, RenderMaterial=sso_3, selectedKitName="Objects")
sg = SpeckleGroup(Objects=eso_4)
sg_2 = SpeckleGroup(Objects=eso_3)
merge_9 = Merge(Data1=sg, Data2=sg_2)
cso_3 = CreateSpeckleObject(Geometry=merge_9, selectedKitName="Objects")

# ----
cso_4 = CreateSpeckleObject(Name=cset.Set, Type="building", selectedKitName="Objects")
crke_3 = CreateRangekeeperEntity(SpeckleObject=cso_4)  # -> simplify(graft(Entity))

# ---- group: buildingSubAssemblies
merge_10 = Merge(Data1=clean_7, Data2=clean_6)

# ----
crossref_5 = CrossReference(ListA=simplify(graft(crke_3)), ListB=merge_10, CrossMode=1)  # -> ListA, ListB
arkr_2 = AddRelationships(Entity=crke_3, SourceEntities=crossref_5.ListA, TargetEntities=crossref_5.ListB, RelationshipTypes="spatiallyContains")
cso_5 = CreateSpeckleObject(Name="development", Type="development", selectedKitName="Objects")
crke_4 = CreateRangekeeperEntity(SpeckleObject=cso_5)

list_2 = Accounts(
    {"No account selected": , "Account (danfink@mit.edu | https://speckle.xyz)": "3865a09189"}, selected="Account (danfink@mit.edu | https://speckle.xyz)",
    selectedId="3865a09189",
    selectedServer="https://speckle.xyz")
screate = CreateStream(SpeckleAccount=list_2, stream="f5e306e3fa https://speckle.xyz 3865a09189")
sup = StreamUpdate(Stream=screate, Name="RangekeeperDemo", Public=True)

# ---- group: Utilities Assembly
dso_6 = DeconstructSpeckleObject(SpeckleObject=clean_6, selectedKitName="Objects")  # -> DisplayValue, EntityId, Name, RenderMaterial, Type, Use
tmatch_5 = MatchText(Text=dso_6.Name, RegEx="plant", Case=True)  # -> simplify(Match)
dispatch_3 = Dispatch(List=clean_6, DispatchPattern=tmatch_5)  # -> ListA, ListB
dispatch_4 = Dispatch(List=clean_7, DispatchPattern=tmatch_5)  # -> ListA, ListB
merge_11 = Merge(Data1=dispatch_3.ListB, Data2=dispatch_4.ListA)
cso_6 = CreateSpeckleObject(Name="utilities", Type="utilities", selectedKitName="Objects")
crossref_6 = CrossReference(ListA=dispatch_3.ListB, ListB=dispatch_4.ListB, CrossMode=1)  # -> flatten(ListA), flatten(ListB)
crossref_7 = CrossReference(ListA=flatten(dispatch_3.ListA), ListB=flatten(merge_11), CrossMode=1)  # -> ListA, ListB

# ----
crossref_8 = CrossReference(ListA=cso_6, ListB=flatten(clean_6), CrossMode=1)  # -> ListA, ListB
arkr_3 = AddRelationships(Entity=cso_6, SourceEntities=crossref_8.ListA, TargetEntities=crossref_8.ListB, RelationshipTypes="contains")

# ---- group: Utilities Assembly (continued)
arkr_4 = AddRelationships(Entity=arkr_3, SourceEntities=crossref_7.ListA, TargetEntities=crossref_7.ListB, RelationshipTypes="services")
arkr_5 = AddRelationships(Entity=arkr_4, SourceEntities=crossref_6.ListA, TargetEntities=crossref_6.ListB, RelationshipTypes="services")

# ----
panel_3 = Panel(arkr_3)
merge_12 = Merge(Data1=flatten(arkr_2), Data2=arkr_5)
crossref_9 = CrossReference(ListA=crke_4, ListB=merge_12, CrossMode=1)  # -> flatten(ListA), flatten(ListB)
arkr_6 = AddRelationships(Entity=crke_4, SourceEntities=crossref_9.ListA, TargetEntities=crossref_9.ListB, RelationshipTypes="spatiallyContains")

send = Send(
    Stream=screate,
    Scenario=arkr_6,
    Context=cso_3,
    AutoSend=False,
    BaseId="b914ed89cf5040b5d05ff14d22e49c39",
    CurrentComponentState="up_to_date",
    KitName="Objects",
    OutputWrappers="https://speckle.xyz\tf5e306e3fa\t6018e7fe7b",
    UseDefaultCache=True,
    selectedKitName="Objects")

panel_4 = Panel(send)
