# Grasshopper definition testRkGh.ghx (Grasshopper 1.0.7)
# plug-ins: eleFront, Speckle 2, Rangekeeper

# ---- group: FFL Zs
number_slider = Slider(0, range=0..100)
series = Series(Start=0, Step=Slider(3.1, range=0..10), Count=100)
merge = Merge(Data1=Slider(6.2, range=0..10), Data2=Slider(3.1, range=0..10))
addition = Addition(A=series, B=Slider(5, range=0..10))
neg = Negative(Value=merge)
ins = InsertItems(List=addition, Item=number_slider, Indices=number_slider, Wrap=True)
ins_2 = InsertItems(List=ins, Item=neg, Indices=number_slider, Wrap=True)
addition_2 = Addition(A=ins_2, B=Slider(0.3, range=0..1))

# ----
reflay = ReferenceByLayer(LayerName="complex::*", lightweight=False)

pt = ConstructPoint(XCoordinate=0, YCoordinate=0, ZCoordinate=addition_2)
xy = XYPlane(Origin=pt)
contour = ContourEx(Shape=simplify(graft(reflay)), Plane=xy, Distances=Slider(0, range=0..100))
data = Data(simplify(graft(reflay)))
clean = CleanTree(RemoveNulls=True, RemoveInvalid=True, RemoveEmpty=True, Tree=contour)
path_mapper = PathMapper(clean, source="{A;B;C;D;E}", target="{C}")
boundary = BoundarySurfaces(Edges=path_mapper)
cso = CreateSpeckleObject(Geometry=data, selectedKitName="Objects")
rhatt = GetRhinoAttributes(Geometry=data, fullpath=False)  # -> Name, Layer, Color, MaterialName, SourceFile
getuv = GetUserValue(Geometry=data, Key="type")  # -> simplify(Values)
area = Area(Geometry=boundary)  # -> Area, Centroid
pdecon = Deconstruct(Point=area.Centroid)  # -> XComponent, YComponent, ZComponent
split = TextSplit(Text=rhatt.Layer, Separators=" ")
txt = Text(flatten(pdecon.ZComponent))
item = ListItem(List=split, Index=0, Wrap=True)  # -> Item1, Item
tmatch = MatchText(Text=graft(txt), Pattern=addition_2, Case=True)
split_2 = TextSplit(Text=item.Item1, Separators="::")
mindex = MemberIndex(Set=tmatch, Member=Toggle(True))  # -> flatten(Index), Count
item_2 = ListItem(List=simplify(split_2), Index=0, Wrap=True)  # -> Item1, Item, Item1_2, Item2
unflatten = UnflattenTree(Tree=mindex.Index, Guide=pdecon.ZComponent)
panel = Panel(item_2.Item)
merge_2 = Merge(Data1=item_2.Item2, Data2=item_2.Item1)
join = TextJoin(Text=merge_2)  # -> simplify(Result)
subtraction = Subtraction(A=unflatten, B=Slider(2, range=0..10))
cso_2 = CreateSpeckleObject(Geometry=boundary, selectedKitName="Objects")
cso_3 = CreateSpeckleObject(FloorFFL=pdecon.ZComponent, FloorGFA=area.Area, selectedKitName="Objects")
cso_4 = CreateSpeckleObject(FloorNum=subtraction, selectedKitName="Objects")
case = TextCase(Text="Floor", Culture=127)  # -> UpperCase, LowerCase
crossref = CrossReference(ListA="Floor", ListB=subtraction, CrossMode=1)  # -> ListA, ListB
merge_3 = Merge(Data1=graft(crossref.ListA), Data2=graft(crossref.ListB))
join_2 = TextJoin(Text=merge_3)
pshift = ShiftPaths(Data=join_2, Offset=-1)
tstat = TreeStatistics(Tree=pshift)  # -> Paths, Length, Count
crossref_2 = CrossReference(ListA=join, ListB=pshift, CrossMode=1)  # -> ListA, ListB
merge_4 = Merge(Data1=graft(crossref_2.ListA), Data2=graft(crossref_2.ListB))
crke = CreateRangekeeperEntity(EntityName=join, Type=getuv, SpeckleObject=cso)
join_3 = TextJoin(Text=merge_4)
dso = DeconstructSpeckleObject(SpeckleObject=crke, selectedKitName="Objects")  # -> Attributes, EntityId, Events, Geometry, Measurements, Name, Type
pshift_2 = ShiftPaths(Data=join_3, Offset=-1)
crke_2 = CreateRangekeeperEntity(EntityName=pshift_2, Type=case.LowerCase, SpeckleObject=cso_2)
decompose_list = DecomposeList(O=dso.Attributes)  # -> A
# ---------- decompose_list: C# ----------
    A = O;
# ---------- end decompose_list ----------

# ---- group: Floors
arkp = AddPropertiesToARangekeeperEntity(Entity=crke_2, Attributes=cso_4, Measurements=cso_3)

# ----
concat = Concatenate(FragmentA=dso.Name, FragmentB="Compartment")
case_2 = TextCase(Text="Compartment", Culture=127)  # -> UpperCase, LowerCase
crka = CreateRangekeeperAssembly(AssemblyName=concat, Type=case_2.LowerCase)  # -> simplify(Assembly)
dso_2 = DeconstructSpeckleObject(SpeckleObject=crka, selectedKitName="Objects")  # -> Attributes, Entities, EntityId, EntityIds, Events, Measurements, Name, Relationships, Type
crossref_3 = CrossReference(ListA=crke, ListB=arkp, CrossMode=1)  # -> ListA, ListB
ar = AddRelationshipsToARangekeeperAssembly(Assembly=crka, SourceRangekeeperEntities=crka, TargetRangekeeperEntities=crke, RelationshipTypes="boundedBy")
decompose_list_2 = DecomposeList(O=dso_2.Entities)  # -> A; same code as decompose_list
srl = Serialize(Base=dso_2.Entities)
panel_2 = Panel(decompose_list_2)

# ---- group: compartments
ar_2 = AddRelationshipsToARangekeeperAssembly(Assembly=ar, TargetRangekeeperEntities=crossref_3.ListB, RelationshipTypes="contains")

# ----
decompose_list_3 = DecomposeList(O=ar_2)  # -> A; same code as decompose_list
dso_3 = DeconstructSpeckleObject(SpeckleObject=ar, selectedKitName="Objects")  # -> Attributes, Entities, EntityId, EntityIds, Events, Measurements, Name, Relationships, Type
dso_4 = DeconstructSpeckleObject(SpeckleObject=ar_2, selectedKitName="Objects")  # -> Entities, simplify(Name)
dso_5 = DeconstructSpeckleObject(SpeckleObject=dso_4.Entities, selectedKitName="Objects")
srl_2 = Serialize(Base=dso_5)
dso_6 = DeconstructSpeckleObject(SpeckleObject=ar, selectedKitName="Objects")  # -> Attributes, Entities, EntityId, EntityIds, Events, Measurements, Name, Relationships, Type
decompose_list_4 = DecomposeList(O=dso_3.Entities)  # -> A; same code as decompose_list
merge_5 = Merge(Data1=dso_3.Type, Data2=dso_3.Entities)
cset = CreateSet(List=flatten(item_2.Item2))  # -> Set, Map
srl_3 = Serialize(Base=dso_6.Relationships)
decompose_list_5 = DecomposeList(O=dso_6.Entities)  # -> A; same code as decompose_list
panel_3 = Panel(srl_3)
item_3 = ListItem(List=decompose_list_4, Index=0, Wrap=True)  # -> Item, Item1
tmatch_2 = MatchText(Text=dso_4.Name, RegEx=cset.Set, Case=True)
pshift_3 = ShiftPaths(Data=dso_6.EntityId, Offset=-1)
panel_4 = Panel("building")
path_mapper_2 = PathMapper(tmatch_2, source="{A}(i)", target="{i}")
dso_7 = DeconstructSpeckleObject(SpeckleObject=item_3.Item1, selectedKitName="Objects")  # -> Attributes, EntityId, Events, Measurements, Name, Type
graft = GraftTree(Tree=cset.Set, IncludeEmptyLists=True, IncludeNullItems=True)  # -> simplify(Tree)
flatten = FlattenTree(Tree=ar_2, Path="{0}")
panel_5 = Panel(decompose_list_4)
crka_2 = CreateRangekeeperAssembly(AssemblyName=graft, Type="building")
dispatch = Dispatch(List=flatten, DispatchPattern=path_mapper_2)  # -> ListA, ListB
crossref_4 = CrossReference(ListA=crka_2, ListB=dispatch.ListA, CrossMode=1)  # -> ListA, ListB

# ---- group: buildings
ar_3 = AddRelationshipsToARangekeeperAssembly(
    Assembly=crka_2,
    SourceRangekeeperEntities=crossref_4.ListA,
    TargetRangekeeperEntities=dispatch.ListA,
    RelationshipTypes="contains")  # -> flatten(Assembly)

# ----
cset_2 = CreateSet(List=flatten(item_2.Item))  # -> Set, Map
dso_8 = DeconstructSpeckleObject(SpeckleObject=ar_3, selectedKitName="Objects")
panel_6 = Panel(cset_2.Set)
decompose_list_6 = DecomposeList(O=dso_8)  # -> A; same code as decompose_list
list = Accounts(
    {"No account selected": , "Account (danfink@mit.edu | https://speckle.xyz)": "3865a09189"}, selected="Account (danfink@mit.edu | https://speckle.xyz)",
    selectedId="3865a09189",
    selectedServer="https://speckle.xyz")
crka_3 = CreateRangekeeperAssembly(AssemblyName=cset_2.Set, Type=panel_6)
crossref_5 = CrossReference(ListA=ar_3, ListB="contains", CrossMode=1)  # -> ListA, ListB
dso_9 = DeconstructSpeckleObject(SpeckleObject=decompose_list_6, selectedKitName="Objects")
ar_4 = AddRelationshipsToARangekeeperAssembly(Assembly=crka_3, TargetRangekeeperEntities=ar_3, RelationshipTypes=crossref_5.ListB)
decompose_list_7 = DecomposeList(O=dso_9)  # -> A; same code as decompose_list
dso_10 = DeconstructSpeckleObject(SpeckleObject=ar_3, selectedKitName="Objects")
item_4 = ListItem(List=decompose_list_6, Index=0, Wrap=True)  # -> Item, Item1
screate = CreateStream(SpeckleAccount=list, stream="f5e306e3fa https://speckle.xyz 3865a09189")
send = Send(
    Stream=screate,
    Data=arkp,
    AutoSend=False,
    BaseId="193ea9c7c57abbcd94e185f970dc1205",
    CurrentComponentState="expired",
    KitName="Objects",
    OutputWrappers="https://speckle.xyz\tf5e306e3fa\tdfb7957872",
    UseDefaultCache=True,
    selectedKitName="Objects")
panel_7 = Panel(send)
decompose_list_8 = DecomposeList(O=dso_10)  # -> A; same code as decompose_list
sup = StreamUpdate(Stream=screate, Name="RangekeeperDemo", Public=True)
dso_11 = DeconstructSpeckleObject(SpeckleObject=decompose_list_7, selectedKitName="Objects")  # -> Entities, EntityId
panel_8 = Panel(dso_11.EntityId)
srl_4 = Serialize(Base=decompose_list_7)
dso_12 = DeconstructSpeckleObject(SpeckleObject=decompose_list_8, selectedKitName="Objects")  # -> Entities, Name
decompose_list_9 = DecomposeList(O=dso_11.Entities)  # -> A; same code as decompose_list
data_2 = Data(simplify(dso_12.Name))
pshift_4 = ShiftPaths(Data=data_2, Offset=-1)
panel_9 = Panel(pshift_4)
decompose_list_10 = DecomposeList(O=dso_12.Entities)  # -> simplify(A); same code as decompose_list
viewer = ParamViewer(decompose_list_10)
panel_10 = Panel(decompose_list_10)
branch = TreeBranch(Tree=decompose_list_10, Path="{0;7}", MaintainPaths=True)
pshift_5 = ShiftPaths(Data=decompose_list_10, Offset=-1)
dso_13 = DeconstructSpeckleObject(SpeckleObject=decompose_list_10, selectedKitName="Objects")
decompose_list_11 = DecomposeList(O=dso_13)  # -> A; same code as decompose_list
dso_14 = DeconstructSpeckleObject(SpeckleObject=decompose_list_11, selectedKitName="Objects")
